# Grasshopper definition icons.gh (Grasshopper 1.0.8)
# plug-ins: Heteroptera, treesloth01, Pufferfish, GrasshopperRender, Pigletto, eleFront5

geometry = Geometry([<brep referenced from the Rhino model> x4])
geometry_2 = Geometry(<brep referenced from the Rhino model>)
geometry_3 = Geometry([<brep referenced from the Rhino model> x2])
geometry_4 = Geometry(<brep referenced from the Rhino model>)
mesh = Mesh(geometry)
mesh_2 = Mesh(geometry_2)
mesh_3 = Mesh(geometry_3)
mesh_join = MeshJoin(Meshes=mesh)
mesh_4 = Mesh(geometry_4)
pigture_material = PigtureMaterial(
    Preset="White Plaster",
    Color=ColourSwatch(SwatchColor=RGB(0, 166, 105)),
    Opacity=Slider(0.55, range=0..1),
    SelectedPreset="White Plaster")  # -> Material, Preview
pigture_material_2 = PigtureMaterial(
    Preset="White Plaster",
    Color=ColourSwatch(SwatchColor=RGB(240, 240, 240)),
    Opacity=Slider(0.55, range=0..1),
    SelectedPreset="White Plaster")  # -> Material, Preview
get_current_file = GetCurrentFile()  # -> Folder, FileName, Worksession
geometry_5 = Geometry(<brep referenced from the Rhino model>)
mesh_join_2 = MeshJoin(Meshes=mesh_2)
geometry_6 = Geometry(<brep referenced from the Rhino model>)
pigture_material_3 = PigtureMaterial(
    Preset="White Plaster",
    Color=ColourSwatch(SwatchColor=RGB(38, 38, 38)),
    Opacity=Slider(0.55, range=0..1),
    SelectedPreset="White Plaster")  # -> Material, Preview
get_current_file_2 = GetCurrentFile()  # -> Folder, FileName, Worksession
mesh_join_3 = MeshJoin(Meshes=mesh_3)
pigture_material_4 = PigtureMaterial(
    Preset="White Plaster",
    Color=ColourSwatch(SwatchColor=RGB(0, 166, 105)),
    Opacity=Slider(0.55, range=0..1),
    SelectedPreset="White Plaster")  # -> Material, Preview
mesh_join_4 = MeshJoin(Meshes=mesh_4)
geometry_7 = Geometry([<surface referenced from the Rhino model> x5])
bounding_rectangle = BoundingRectangle(Geometry=geometry, Plane=PlaneXY(0, 0, 0), Axis=0, Slide=0, Union=True)  # -> Bounding, DimensionX, DimensionY
center = Center(Geometry=geometry, forall=True)  # -> Center, Dimension
geometry_8 = Geometry(<brep referenced from the Rhino model>)
bounding_rectangle_2 = BoundingRectangle(Geometry=geometry_4, Plane=PlaneXY(0, 0, 0), Axis=0, Slide=0, Union=True)  # -> Bounding, DimensionX, DimensionY
center_2 = Center(Geometry=geometry_4, forall=True)  # -> Center, Dimension
mesh_5 = Mesh(geometry_5)
mesh_6 = Mesh(geometry_6)
concatenate = Concatenate(FragmentA=get_current_file.Folder, FragmentB="\OrcaSlicericon.png")
mesh_7 = Mesh(geometry_7)
mesh_8 = Mesh(geometry_8)
concatenate_2 = Concatenate(FragmentA=get_current_file_2.Folder, FragmentB="\BambuSlicericon.png")
add_material = AddMaterial(Material=pigture_material_2.Material)
data_tree_match = DataTreeMatch(Guide=geometry, Match=pigture_material.Material)  # -> Guide, Matched
render_attributes = RenderAttributes(ObjectMaterial=data_tree_match.Matched)  # -> Render, ObjectMaterial, CastsShadows, ReceivesShadows
add_material_2 = AddMaterial(Material=pigture_material_3.Material)
get_current_file_3 = GetCurrentFile()  # -> Folder, FileName, Worksession
pigture_material_5 = PigtureMaterial(
    Preset="White Plaster",
    Color=ColourSwatch(SwatchColor=RGB(227, 227, 227)),
    Opacity=Slider(0.55, range=0..1),
    SelectedPreset="White Plaster")  # -> Material, Preview
mesh_join_5 = MeshJoin(Meshes=mesh_5)
pigture_material_6 = PigtureMaterial(
    Preset="White Plaster",
    Color=ColourSwatch(SwatchColor=RGB(214, 87, 28)),
    Opacity=Slider(0.55, range=0..1),
    SelectedPreset="White Plaster")  # -> Material, Preview
add_material_3 = AddMaterial(Material=pigture_material_4.Material)
mesh_join_6 = MeshJoin(Meshes=mesh_6)
discontinuity = Discontinuity(Curve=bounding_rectangle.Bounding, Level=1)  # -> Points, Parameters
geometry_9 = Geometry(<surface referenced from the Rhino model>)
get_current_file_4 = GetCurrentFile()  # -> Folder, FileName, Worksession
geometry_10 = Geometry([<brep referenced from the Rhino model> x2])
pigture_material_7 = PigtureMaterial(
    Preset="White Plaster",
    Color=ColourSwatch(SwatchColor=RGB(255, 0, 0)),
    Opacity=Slider(0.55, range=0..1),
    SelectedPreset="White Plaster")  # -> Material, Preview
mesh_join_7 = MeshJoin(Meshes=mesh_7)
pigture_material_8 = PigtureMaterial(
    Preset="White Plaster",
    Color=ColourSwatch(SwatchColor=RGB(214, 171, 62)),
    Opacity=Slider(0.1, range=0..1),
    SelectedPreset="White Plaster")  # -> Material, Preview
set_material = SetMaterial(Object=mesh_join_2, Material=add_material)  # -> Object, Material
discontinuity_2 = Discontinuity(Curve=bounding_rectangle_2.Bounding, Level=1)  # -> Points, Parameters
mesh_join_8 = MeshJoin(Meshes=mesh_8)
bounding_rectangle_3 = BoundingRectangle(Geometry=geometry_6, Plane=PlaneXY(0, 0, 0), Axis=0, Slide=0, Union=True)  # -> Bounding, DimensionX, DimensionY
center_3 = Center(Geometry=geometry_6, forall=True)  # -> Center, Dimension
group = Group(Geometry=data_tree_match.Guide)
bounding_rectangle_4 = BoundingRectangle(Geometry=geometry_8, Plane=PlaneXY(0, 0, 0), Axis=0, Slide=0, Union=True)  # -> Bounding, DimensionX, DimensionY
center_4 = Center(Geometry=geometry_8, forall=True)  # -> Center, Dimension
mesh_9 = Mesh(geometry_9)
concatenate_3 = Concatenate(FragmentA=get_current_file_3.Folder, FragmentB="\PrusaSlicericon.png")
mesh_10 = Mesh(geometry_10)
add_material_4 = AddMaterial(Material=pigture_material_5.Material)
set_material_2 = SetMaterial(Object=mesh_join_3, Material=add_material_2)  # -> Object, Material
concatenate_4 = Concatenate(FragmentA=get_current_file_4.Folder, FragmentB="\slic3rgroupicon.png")
list_item = ListItem(List=discontinuity.Points, Index=0, Wrap=True)  # -> Item, Item1, Item2
set_material_3 = SetMaterial(Object=mesh_join_4, Material=add_material_3)  # -> Object, Material
model_object = ModelObject(Geometry=geometry, Render=render_attributes.Render)  # -> Object, Geometry, Name, Layer, Visibility, Display, Drafting, Render
add_material_5 = AddMaterial(Material=pigture_material_6.Material)
add_material_6 = AddMaterial(Material=pigture_material_7.Material)
get_current_file_5 = GetCurrentFile()  # -> Folder, FileName, Worksession
list_item_2 = ListItem(List=discontinuity_2.Points, Index=0, Wrap=True)  # -> Item, Item1, Item2
pigture_material_9 = PigtureMaterial(
    Preset="White Plaster",
    Color=ColourSwatch(SwatchColor=RGB(255, 0, 0)),
    Opacity=Slider(0.55, range=0..1),
    SelectedPreset="White Plaster")  # -> Material, Preview
mesh_join_9 = MeshJoin(Meshes=mesh_9)
pigture_material_10 = PigtureMaterial(
    Preset="White Plaster",
    Color=ColourSwatch(SwatchColor=RGB(214, 171, 62)),
    Opacity=Slider(0.83, range=0..1),
    SelectedPreset="Tinted Glass Amber")  # -> Material, Preview
mesh_join_10 = MeshJoin(Meshes=mesh_10)
discontinuity_3 = Discontinuity(Curve=bounding_rectangle_3.Bounding, Level=1)  # -> Points, Parameters
add_material_7 = AddMaterial(Material=pigture_material_8.Material)
set_material_4 = SetMaterial(Object=mesh_join, Material=pigture_material.Material)  # -> Object, Material
distance = Distance(PointA=list_item.Item, PointB=list_item.Item2)
unit_z = UnitZ(Factor=distance)
discontinuity_4 = Discontinuity(Curve=bounding_rectangle_4.Bounding, Level=1)  # -> Points, Parameters
bounding_rectangle_5 = BoundingRectangle(Geometry=geometry_10, Plane=PlaneXY(0, 0, 0), Axis=0, Slide=0, Union=True)  # -> Bounding, DimensionX, DimensionY
center_5 = Center(Geometry=geometry_10, forall=True)  # -> Center, Dimension
distance_2 = Distance(PointA=list_item_2.Item, PointB=list_item_2.Item2)
unit_z_2 = UnitZ(Factor=distance_2)
set_material_5 = SetMaterial(Object=mesh_join_5, Material=add_material_4)  # -> Object, Material
concatenate_5 = Concatenate(FragmentA=get_current_file_5.Folder, FragmentB="\slic3ricon.png")
set_material_6 = SetMaterial(Object=mesh_join_6, Material=add_material_5)  # -> Object, Material
add_material_8 = AddMaterial(Material=pigture_material_9.Material)
set_material_7 = SetMaterial(Object=mesh_join_7, Material=add_material_6)  # -> Object, Material
list_item_3 = ListItem(List=discontinuity_3.Points, Index=0, Wrap=True)  # -> Item, Item1, Item2
move = Move(Geometry=center.Center, Motion=unit_z)  # -> Geometry, Transform
set_material_8 = SetMaterial(Object=mesh_join_8, Material=add_material_7)  # -> Object, Material
number_slider = Slider(1.11, range=0..10)
add_material_9 = AddMaterial(Material=pigture_material_10.Material)
list_item_4 = ListItem(List=discontinuity_4.Points, Index=0, Wrap=True)  # -> Item, Item1, Item2
move_2 = Move(Geometry=center_2.Center, Motion=unit_z_2)  # -> Geometry, Transform
number_slider_2 = Slider(1.11, range=0..10)
discontinuity_5 = Discontinuity(Curve=bounding_rectangle_5.Bounding, Level=1)  # -> Points, Parameters
distance_3 = Distance(PointA=list_item_3.Item, PointB=list_item_3.Item2)
unit_z_3 = UnitZ(Factor=distance_3)
distance_4 = Distance(PointA=list_item_4.Item, PointB=list_item_4.Item2)
unit_z_4 = UnitZ(Factor=distance_4)
set_material_9 = SetMaterial(Object=mesh_join_9, Material=add_material_8)  # -> Object, Material
entwine = Entwine(Branch00=set_material_3.Object, Branch01=set_material_2.Object, Branch02=set_material.Object, FlattenInputs=True)
set_material_10 = SetMaterial(Object=mesh_join_10, Material=add_material_9)  # -> Object, Material
list_item_5 = ListItem(List=discontinuity_5.Points, Index=0, Wrap=True)  # -> Item, Item1, Item2
move_3 = Move(Geometry=center_3.Center, Motion=unit_z_3)  # -> Geometry, Transform
number_slider_3 = Slider(1.11, range=0..10)
point_light = PointLight(
    Location=move.Geometry,
    Enabled=Toggle(True),
    Intensity=Slider(1.11, range=0..10),
    ShadowIntensity=number_slider,
    Falloff=number_slider)  # -> PointLight, Location
move_4 = Move(Geometry=center_4.Center, Motion=unit_z_4)  # -> Geometry, Transform
render_trigger = RenderTrigger(Button=Button())
number_slider_4 = Slider(1.11, range=0..10)
point_light_2 = PointLight(
    Location=move_2.Geometry,
    Enabled=Toggle(True),
    Intensity=Slider(1.11, range=0..10),
    ShadowIntensity=number_slider_2,
    Falloff=number_slider_2)  # -> PointLight, Location
shift_paths = ShiftPaths(Data=entwine, Offset=-1)
render_trigger_2 = RenderTrigger(Button=Button())
distance_5 = Distance(PointA=list_item_5.Item, PointB=list_item_5.Item2)
unit_z_5 = UnitZ(Factor=distance_5)
entwine_2 = Entwine(Branch00=set_material_6.Object, Branch01=set_material_5.Object, FlattenInputs=True)
entwine_3 = Entwine(Branch00=set_material_8.Object, Branch01=set_material_7.Object, FlattenInputs=True)
move_5 = Move(Geometry=center_5.Center, Motion=unit_z_5)  # -> Geometry, Transform
number_slider_5 = Slider(1.11, range=0..10)
point_light_3 = PointLight(
    Location=move_3.Geometry,
    Enabled=Toggle(True),
    Intensity=Slider(1.11, range=0..10),
    ShadowIntensity=number_slider_3,
    Falloff=number_slider_3)  # -> PointLight, Location
production_render = ProductionRender(
    Geometry=set_material_4.Object,
    Lights=point_light.PointLight,
    Width=800,
    Height=600,
    Passes=Slider(1500, range=0..10000),
    Transparent=Toggle(True),
    ZoomToSubject=Toggle(True),
    ExperimentalDisplacement=Toggle(False),
    Run=render_trigger,
    Channels="RGBA",
    EnabledChannels="RGBA,Wireframe,Depth,Normal,Albedo,MaterialID,ObjectID")  # -> Package, Preview, Log, RImageFile
shift_paths_2 = ShiftPaths(Data=entwine_2, Offset=-1)
render_trigger_3 = RenderTrigger(Button=Button())
shift_paths_3 = ShiftPaths(Data=entwine_2, Offset=-1)
point_light_4 = PointLight(
    Location=move_4.Geometry,
    Enabled=Toggle(True),
    Intensity=Slider(1.11, range=0..10),
    ShadowIntensity=number_slider_4,
    Falloff=number_slider_4)  # -> PointLight, Location
production_render_2 = ProductionRender(
    Geometry=shift_paths,
    Lights=point_light_2.PointLight,
    Width=800,
    Height=600,
    Passes=Slider(1500, range=0..10000),
    Transparent=Toggle(True),
    ZoomToSubject=Toggle(True),
    ExperimentalDisplacement=Toggle(False),
    Run=render_trigger_2,
    Channels="RGBA",
    EnabledChannels="RGBA,Wireframe,Depth,Normal,Albedo,MaterialID,ObjectID")  # -> Package, Preview, Log, RImageFile
render_trigger_4 = RenderTrigger(Button=Button())
shift_paths_4 = ShiftPaths(Data=entwine_3, Offset=-1)
entwine_4 = Entwine(Branch00=set_material_10.Object, Branch01=set_material_9.Object, FlattenInputs=True)
point_light_5 = PointLight(
    Location=move_5.Geometry,
    Enabled=Toggle(True),
    Intensity=Slider(1.11, range=0..10),
    ShadowIntensity=number_slider_5,
    Falloff=number_slider_5)  # -> PointLight, Location
production_render_3 = ProductionRender(
    Geometry=shift_paths_3,
    Lights=point_light_3.PointLight,
    Width=800,
    Height=600,
    Passes=Slider(1500, range=0..10000),
    Transparent=Toggle(True),
    ZoomToSubject=Toggle(True),
    ExperimentalDisplacement=Toggle(False),
    Run=render_trigger_3,
    Channels="RGBA",
    EnabledChannels="RGBA,Wireframe,Depth,Normal,Albedo,MaterialID,ObjectID")  # -> Package, Preview, Log, RImageFile
render_trigger_5 = RenderTrigger(Button=Button())
shift_paths_5 = ShiftPaths(Data=entwine_4, Offset=-1)
production_render_4 = ProductionRender(
    Geometry=shift_paths_4,
    Lights=point_light_4.PointLight,
    Width=800,
    Height=600,
    Passes=Slider(1500, range=0..10000),
    Transparent=Toggle(True),
    ZoomToSubject=Toggle(True),
    ExperimentalDisplacement=Toggle(False),
    Run=render_trigger_4,
    Channels="RGBA",
    EnabledChannels="RGBA,Wireframe,Depth,Normal,Albedo,MaterialID,ObjectID")  # -> Package, Preview, Log, RImageFile
read_rimage = ReadRImage(File=production_render.RImageFile, Run=Toggle(True), EnabledChannels="RGBA,Depth,Normal,Albedo,MaterialID,ObjectID")  # -> RGBA, Depth, Normal, Albedo, MaterialID, ObjectID, Info
read_rimage_2 = ReadRImage(File=production_render_2.RImageFile, Run=Toggle(True), EnabledChannels="RGBA,Depth,Normal,Albedo,MaterialID,ObjectID")  # -> RGBA, Depth, Normal, Albedo, MaterialID, ObjectID, Info
deconstruct_render = DeconstructRender(Package=production_render.Package)  # -> RGBA, Alpha, Depth, Normal, Albedo, DiffuseLighting, MaterialID, ObjectID, Wireframe, Info
deconstruct_render_2 = DeconstructRender(Package=production_render_2.Package)  # -> RGBA, Alpha, Depth, Normal, Albedo, DiffuseLighting, MaterialID, ObjectID, Wireframe, Info
production_render_5 = ProductionRender(
    Geometry=shift_paths_5,
    Lights=point_light_5.PointLight,
    Width=800,
    Height=600,
    Passes=Slider(1500, range=0..10000),
    Transparent=Toggle(True),
    ZoomToSubject=Toggle(True),
    ExperimentalDisplacement=Toggle(False),
    Run=render_trigger_5,
    Channels="RGBA",
    EnabledChannels="RGBA,Wireframe,Depth,Normal,Albedo,MaterialID,ObjectID")  # -> Package, Preview, Log, RImageFile
read_rimage_3 = ReadRImage(File=production_render_3.RImageFile, Run=Toggle(True), EnabledChannels="RGBA,Depth,Normal,Albedo,MaterialID,ObjectID")  # -> RGBA, Depth, Normal, Albedo, MaterialID, ObjectID, Info
read_rimage_4 = ReadRImage(File=production_render_4.RImageFile, Run=Toggle(True), EnabledChannels="RGBA,Depth,Normal,Albedo,MaterialID,ObjectID")  # -> RGBA, Depth, Normal, Albedo, MaterialID, ObjectID, Info
deconstruct_render_3 = DeconstructRender(Package=production_render_3.Package)  # -> RGBA, Alpha, Depth, Normal, Albedo, DiffuseLighting, MaterialID, ObjectID, Wireframe, Info
deconstruct_render_4 = DeconstructRender(Package=production_render_4.Package)  # -> RGBA, Alpha, Depth, Normal, Albedo, DiffuseLighting, MaterialID, ObjectID, Wireframe, Info
read_rimage_5 = ReadRImage(File=production_render_5.RImageFile, Run=Toggle(True), EnabledChannels="RGBA,Depth,Normal,Albedo,MaterialID,ObjectID")  # -> RGBA, Depth, Normal, Albedo, MaterialID, ObjectID, Info
deconstruct_render_5 = DeconstructRender(Package=production_render_5.Package)  # -> RGBA, Alpha, Depth, Normal, Albedo, DiffuseLighting, MaterialID, ObjectID, Wireframe, Info
render_viewer = RenderViewer(Bitmap=deconstruct_render.RGBA, SavePath=concatenate_2, Format="PNG", PreviewScale=1)  # -> FilePath, Success
render_viewer_2 = RenderViewer(Bitmap=deconstruct_render_2.RGBA, SavePath=concatenate, Format="PNG", PreviewScale=1)  # -> FilePath, Success
render_viewer_3 = RenderViewer(Bitmap=deconstruct_render_3.RGBA, SavePath=concatenate_3, Format="PNG", PreviewScale=1)  # -> FilePath, Success
render_viewer_4 = RenderViewer(Bitmap=deconstruct_render_4.RGBA, SavePath=concatenate_4, Format="PNG", PreviewScale=1)  # -> FilePath, Success
render_viewer_5 = RenderViewer(Bitmap=deconstruct_render_5.RGBA, SavePath=concatenate_5, Format="PNG", PreviewScale=1)  # -> FilePath, Success
