# Grasshopper definition SampleGHFile.gh (Grasshopper 1.0.8)
# plug-ins: treesloth01, SlicerExport, Wombat

query_model_layers = QueryModelLayers(AutoUpdateState=True)
model_layer = ModelLayer(Layer=query_model_layers)  # -> Layer, graft(Name), Hidden, Locked, DisplayColour, Material, Linetype
query_model_objects = QueryModelObjects(Layer=model_layer.Name, AutoUpdateState=True)
shift_paths = ShiftPaths(Data=query_model_objects, Offset=-1)
clean_tree = CleanTree(RemoveNulls=True, RemoveInvalid=True, RemoveEmpty=True, Tree=shift_paths)
panel = Panel("""Part
NegativePart
Modifier
SupportBlocker
SupportEnforcer""")
filter_unmatched = FilterUnmatched(Data0=clean_tree, Data1=model_layer.Name)  # -> Data0, Data1
member_index = MemberIndex(Set=panel, Member=filter_unmatched.Data1)  # -> Index, Count
shift_paths_2 = ShiftPaths(Data=member_index.Index, Offset=-1)
settings_quality = SettingsQuality()
list_item = ListItem(List=panel, Index=shift_paths_2, Wrap=True)
mesh_brep = MeshBrep(Brep=filter_unmatched.Data0, Settings=settings_quality)
mesh_join = MeshJoin(Meshes=mesh_brep)
create_export_object = CreateExportObject(Mesh=mesh_join, PartType=shift_paths_2, Name=list_item)
panel_2 = Panel("""PrusaSlicer
OrcaSlicer
BambuStudio""")
shift_paths_3 = ShiftPaths(Data=create_export_object, Offset=-2)
list_indices = ListIndices(Data=panel_2)  # -> graft(Indices)
c_script = CSharpScript()  # -> out, Desktop
# ---------- c_script: C# ----------
// Grasshopper Script Instance
#region Usings
using System;
using System.Linq;
using System.Collections;
using System.Collections.Generic;
using System.Drawing;

using Rhino;
using Rhino.Geometry;

using Grasshopper;
using Grasshopper.Kernel;
using Grasshopper.Kernel.Data;
using Grasshopper.Kernel.Types;
#endregion

public class Script_Instance : GH_ScriptInstance
{
    #region Notes
    /* 
      Members:
        RhinoDoc RhinoDocument
        GH_Document GrasshopperDocument
        IGH_Component Component
        int Iteration

      Methods (Virtual & overridable):
        Print(string text)
        Print(string format, params object[] args)
        Reflect(object obj)
        Reflect(object obj, string method_name)
    */
    #endregion

    private void RunScript(ref object Desktop)
    {
        Desktop = Environment.GetFolderPath(Environment.SpecialFolder.Desktop);
    }
}
# ---------- end c_script ----------
data = Data(graft(panel_2))
concatenate = Concatenate(FragmentA="BenchyModifierTest", FragmentB=data, JoinSeparator="_")
propagate_ancestor = PropagateAncestor(Data=concatenate, Ancestors=shift_paths_3)  # -> UpdatedData, PropagatedAncestors, BarrenAncestors, Orhpans
c_script_2 = CSharpScript(ParentDir=c_script.Desktop, FolderName="Test")  # -> out, FullPath, Exists; inputs ParentDir: String, FolderName: String
# ---------- c_script_2: C# ----------
// Grasshopper Script Instance
#region Usings
using System;
using System.IO;
using System.Linq;
using System.Collections;
using System.Collections.Generic;
using System.Drawing;

using Rhino;
using Rhino.Geometry;

using Grasshopper;
using Grasshopper.Kernel;
using Grasshopper.Kernel.Data;
using Grasshopper.Kernel.Types;
#endregion

public class Script_Instance : GH_ScriptInstance
{
    #region Notes
    /* 
      Members:
        RhinoDoc RhinoDocument
        GH_Document GrasshopperDocument
        IGH_Component Component
        int Iteration

      Methods (Virtual & overridable):
        Print(string text)
        Print(string format, params object[] args)
        Reflect(object obj)
        Reflect(object obj, string method_name)
    */
    #endregion

    private void RunScript(
		string ParentDir,
		string FolderName,
		ref object FullPath,
		ref object Exists)
    {
        string path = Path.Combine(ParentDir, FolderName);
        bool alreadyExists = Directory.Exists(path);

        if (!alreadyExists)
        {
            Directory.CreateDirectory(path);
            Print("Created: " + path);
        }
        else
        {
            Print("Already exists: " + path);
        }

        FullPath = path;
        Exists = alreadyExists;
    }
}
# ---------- end c_script_2 ----------
panel_3 = Panel(".3mf")
shift_paths_4 = ShiftPaths(Data=propagate_ancestor.PropagatedAncestors, Offset=-1)
create_export_group = CreateExportGroup(Objects=shift_paths_4, Name=data)
concatenate_2 = Concatenate(Fragment_A=c_script_2.FullPath, Fragment_B="\", A=data)
export_to_3mf = ExportTo3MF(Groups=create_export_group, SlicerTarget=list_indices, FilePath=concatenate_2, Run=Button(), Launch=False)  # -> Success, Message, FilePath
